# Dynamo graph GitHub Change Object Style Color_UI.dyn (Dynamo 2.19.3.6394)

เปล_ยน_object_และ_line_style_เป = Python()  # "เปลี่ยน Object และ Line Style เป็นสีดำ ยกเว้นสิ่งที่เลือกผ่าน UI"; IronPython2; unwired: IN[0]
# ---------- เปล_ยน_object_และ_line_style_เป.python (67 lines) ----------
import clr
import time
import os

# นำเข้าไลบรารีของ .NET สำหรับจัดการ HTTP Request และ File
clr.AddReference('System')
from System.Net import WebClient, ServicePointManager, SecurityProtocolType
from System.Text import Encoding
from System.IO import File

# --- บังคับให้ใช้ TLS 1.2 --- 
ServicePointManager.SecurityProtocol = SecurityProtocolType.Tls12

# --- [SETTING] Path ต่างๆ ---
token_file_path = r"R:\05_MTC_Library Development\MTC R24\00_BIM_Tools_Library\01_Python-Scripts\02_Git Code Importer\00_Data\ICB_Note.txt"
url = "https://raw.githubusercontent.com/Ittib/ICB_RevitBIMTools/refs/heads/main/tools/Object%26LineStyle/MTC_Change_Object_%26_Line_Style_Color_UI.py"
local_fallback_path = r"R:\05_MTC_Library Development\MTC R24\00_BIM_Tools_Library\02_Dynamo_Scripts\ICB\Python Script Demo\MTC_Change_Object_&_Line_Style_Color_UI.py"

def get_token(path):
    try:
        with open(path, 'r') as f:
            return f.read().strip()
    except:
        return None

script_content = ""
source_info = ""

# --- เริ่มการดึงโค้ด ---
try:
    token = get_token(token_file_path)
    if not token:
        raise Exception("Token file not found or cannot be read.")

    req_url = url + "?t=" + str(int(time.time()))

    client = WebClient()
    client.Headers.Add('Authorization', 'token %s' % token)
    client.Encoding = Encoding.UTF8

    script_content = client.DownloadString(req_url)
    source_info = "🌐 Loaded from GitHub"

except Exception as e:
    if os.path.exists(local_fallback_path):
        try:
            script_content = File.ReadAllText(local_fallback_path, Encoding.UTF8)
            source_info = "⚠️ Loaded from Local Fallback"
        except Exception as read_e:
            script_content = ""
            OUT = "❌ Error reading Local file: " + str(read_e)
    else:
        script_content = ""
        OUT = "❌ Error fetching GitHub & No Local file: " + str(e)

# --- รันโค้ดที่ดึงมาได้ ---
if script_content:
    try:
        script_content = script_content.replace("\r\n", "\n")
        
        # รันใน globals() เพื่อให้โค้ดที่ดึงมามองเห็นตัวแปร IN 
        # และให้ตัวแปร OUT จากโค้ด UI ถูกส่งกลับออกไปที่ Dynamo ได้โดยตรง
        exec(script_content, globals())

    except Exception as run_e:
        # หากโค้ดดึงมาได้แต่รันพัง (เช่น จัดหน้าต่างผิด, หาโมดูลไม่เจอ) จะแสดงให้เห็นตรงนี้
        OUT = "❌ Execution Error (รันโค้ดพัง): " + str(run_e)
# ----------------------------------------
watch = Watch(เปล_ยน_object_และ_line_style_เป)
