# Dynamo graph GitHub Duct Classification.dyn (Dynamo 2.19.3.6394)

python_script = Python()  # CPython3; unwired: IN[0]
# ---------- python_script.python (67 lines) ----------
import clr

# Import RevitAPI
clr.AddReference("RevitAPI")
import Autodesk
from Autodesk.Revit.DB import *

# Import DocumentManager and TransactionManager
clr.AddReference("RevitServices")
import RevitServices
from RevitServices.Persistence import DocumentManager
from RevitServices.Transactions import TransactionManager

doc = DocumentManager.Instance.CurrentDBDocument

# กรองค่า Null ออกจาก List ก่อนเริ่มทำงาน
input_items = IN[0] if isinstance(IN[0], list) else [IN[0]]
items = [UnwrapElement(i) for i in input_items if i is not None]

results = []

# ปรับฟังก์ชันให้เช็ค object ก่อนดึง parameter
def get_value_mm(elem, param_name):
    if elem is None: return 0
    param = elem.LookupParameter(param_name)
    if param and param.HasValue:
        return param.AsDouble() * 304.8
    return 0

TransactionManager.Instance.EnsureInTransaction(doc)

for duct in items:
    # เช็คซ้ำอีกครั้งเพื่อความชัวร์
    if duct is None: continue
    
    w = get_value_mm(duct, "Width")
    h = get_value_mm(duct, "Height")
    d = get_value_mm(duct, "Diameter")
    
    max_val = max(w, h, d)
    
    classification = ""
    if max_val < 600:
        classification = "Light"
    elif 600 <= max_val <= 750:
        classification = "Light-Medium"
    elif 775 <= max_val <= 1500:
        classification = "Medium"
    elif 1525 <= max_val <= 1825:
        classification = "Heavy"
    elif 1850 <= max_val <= 2275:
        classification = "Heavy"
    elif max_val >= 2300:
        classification = "Extra Heavy"
    else:
        classification = "Out of Range"

    target_param = duct.LookupParameter("Duct Classification")
    if target_param and not target_param.IsReadOnly:
        target_param.Set(classification)
        results.append(classification)
    else:
        results.append("Failed: Parameter not found")

TransactionManager.Instance.TransactionTaskDone()

OUT = results
# ----------------------------------------
categories = Categories("OST_DuctCurves")
all_elements_of_category = ElementsOfCategory(Category=categories)
python_script_2 = Python(IN[0]=all_elements_of_category)  # CPython3
# ---------- python_script_2.python (56 lines) ----------
import clr
import urllib.request
import time
import os

# --- [SETTING] Path ต่างๆ ---
# 1. Path เก็บ Token ลับ (ห้ามฝังในโค้ด)
token_file_path = r"R:\05_MTC_Library Development\MTC R24\00_BIM_Tools_Library\01_Python-Scripts\02_Git Code Importer\00_Data\ICB_Note.txt"
# 2. URL ของสคริปต์หลักบน GitHub
url = "https://raw.githubusercontent.com/Ittib/ICB_RevitBIMTools/refs/heads/main/tools/DuctClassification/MTC_Duct%20Classification.py"
# 3. Path ของสคริปต์สำรอง (Local Fallback)
local_fallback_path = r"R:\05_MTC_Library Development\MTC R24\00_BIM_Tools_Library\02_Dynamo_Scripts\ICB\Python Script Demo\MTC_Duct Classification.py"

def get_token(path):
    try:
        with open(path, 'r') as f:
            return f.read().strip()
    except:
        return None

script_content = ""
source_info = ""

# --- เริ่มการดึงโค้ด ---
try:
    token = get_token(token_file_path)
    if not token:
        raise Exception("Token file not found")

    # ดึงจาก GitHub
    req_url = url + "?t=" + str(int(time.time()))
    req = urllib.request.Request(req_url)
    req.add_header('Authorization', 'token %s' % token)

    with urllib.request.urlopen(req, timeout=10) as response:
        script_content = response.read().decode('utf-8')
        source_info = "🌐 Loaded from GitHub (Latest)"

except Exception as e:
    # --- [LOCAL FALLBACK] หากเน็ตหลุดหรือ Token มีปัญหา ---
    if os.path.exists(local_fallback_path):
        with open(local_fallback_path, 'r', encoding='utf-8') as f:
            script_content = f.read()
            source_info = "⚠️ Network Offline: Loaded from Local Fallback"
    else:
        source_info = "❌ Error: Cannot reach GitHub and Local file is missing!"

# --- รันโค้ดที่ดึงมาได้ ---
if script_content:
    try:
        exec(script_content)
        OUT = source_info
    except Exception as run_e:
        OUT = "❌ Script Execution Error: " + str(run_e)
else:
    OUT = source_info
# ----------------------------------------
watch = Watch(python_script_2)
